# Grasshopper definition IPC_Srf Type A.gh (Grasshopper 1.0.7)
# plug-ins: Kangaroo2 Components

direction_0_1 = GetInteger(AtLeast=1, AtMost=1, Maximum=2147483647, Minimum=-2147483648, TreeAccess=False)
division_1 = GetNumber(AtLeast=1, AtMost=100, Maximum=100, Minimum=-1.797693135e+308, TreeAccess=False)
number_slider = Slider(1, range=0..1)
division_2 = GetNumber(AtLeast=1, AtMost=100, Maximum=100, Minimum=-1.797693135e+308, TreeAccess=False)
surface = GetGeometry(AtLeast=1, AtMost=1, DeleteInput=False, Filter=1074004029, TreeAccess=False)
number_slider_2 = Slider(6, range=0..10)
number_slider_3 = Slider(48, range=0..100)
srf = Surface(<surface referenced from the Rhino model>)
edges = BrepEdges(Brep=surface)  # -> Naked, Interior, NonManifold
join = JoinCurves(Curves=edges.Naked, Preserve=False)
explode = Explode(Curve=join, Recursive=True)  # -> Segments, Vertices
item = ListItem(List=explode.Segments, Index=direction_0_1, Wrap=True)  # -> Item, Item1, Item2, Item3
flip = FlipCurve(Curve=item.Item2)  # -> Curve, Flag
merge = Merge(Data1=item.Item, Data2=flip.Curve)
divide = DivideCurve(Curve=merge, Count=division_1, Kinks=False)  # -> Points, Tangents, Parameters
flip_2 = FlipMatrix(Data=divide.Points)
pline = PolyLine(Vertices=flip_2, Closed=False)  # -> simplify(Polyline)
number_slider_4 = Slider(10000, range=0..10000)
panel = Panel("""True
False""")
item_2 = ListItem(List=flatten(pline), Index=0, Wrap=True)  # -> Item1, Item
not = GateNot(A=panel)
ext = ExtendCurve(Curve=item_2.Item, Type=0, Start=number_slider_4, End=number_slider_4)
dispatch = Dispatch(List=flatten(pline), DispatchPattern=not)  # -> ListA, ListB
divide_2 = DivideCurve(Curve=pline, Count=division_2, Kinks=False)  # -> Points, Tangents, Parameters
divide_3 = DivideCurve(Curve=dispatch.ListA, Count=division_2, Kinks=False)  # -> Points, Tangents, Parameters
divide_4 = DivideCurve(Curve=dispatch.ListB, Count=division_2, Kinks=False)  # -> Points, Tangents, Parameters
relitem = RelativeItem(Tree=simplify(divide_2.Points), Offset="{+1}(+1)", WrapPaths=False, WrapItems=False)  # -> ItemA, ItemB
relitem_2 = RelativeItem(Tree=simplify(divide_2.Points), Offset="{+1}(-1)", WrapPaths=False, WrapItems=False)  # -> ItemA, ItemB
dispatch_2 = Dispatch(List=divide_3.Points, DispatchPattern=panel)  # -> ListA, ListB
dispatch_3 = Dispatch(List=divide_4.Points, DispatchPattern=panel)  # -> ListA, ListB
ln = Line(StartPoint=relitem.ItemA, EndPoint=relitem.ItemB)
ln_2 = Line(StartPoint=relitem_2.ItemA, EndPoint=relitem_2.ItemB)
pt = Point(dispatch_3.ListB)
pt_2 = Point(dispatch_2.ListA)
flip_3 = FlipMatrix(Data=ln)  # -> flatten(Data)
flip_4 = FlipMatrix(Data=ln_2)  # -> flatten(Data)
join_2 = JoinCurves(Curves=flip_4, Preserve=False)
join_3 = JoinCurves(Curves=flip_3, Preserve=False)
ext_2 = ExtendCurve(Curve=join_2, Type=0, Start=number_slider_4, End=number_slider_4)
ext_3 = ExtendCurve(Curve=join_3, Type=0, Start=number_slider_4, End=number_slider_4)
crvprox = CurveProximity(CurveA=ext_2, CurveB=ext)  # -> PointA, PointB, Distance
crvprox_2 = CurveProximity(CurveA=ext_3, CurveB=ext)  # -> PointA, PointB, Distance
crv_cp = CurveClosestPoint(Point=crvprox.PointA, Curve=ext_2)  # -> Point, Parameter, Distance
pline_2 = PolyLine(Vertices=divide_4.Points, Closed=False)
crv_cp_2 = CurveClosestPoint(Point=crvprox_2.PointA, Curve=ext_3)  # -> Point, Parameter, Distance
alongcrv = SortAlongCurve(Points=crv_cp.Point, Curve=ext)  # -> Points, Indices
explode_2 = Explode(Curve=pline_2, Recursive=True)  # -> Segments, Vertices
item_3 = ListItem(List=ext_2, Index=alongcrv.Indices, Wrap=True)
alongcrv_2 = SortAlongCurve(Points=crv_cp_2.Point, Curve=ext)  # -> Points, Indices
item_4 = ListItem(List=explode_2.Segments, Index=0, Wrap=True)  # -> Item1, Item
extn = ExtendCurveNegative(Curve=item_3, Type=0, Start=expr("-x", number_slider_4), End=expr("-x", number_slider_4))
item_5 = ListItem(List=ext_3, Index=alongcrv_2.Indices, Wrap=True)
extn_2 = ExtendCurveNegative(Curve=item_5, Type=0, Start=expr("-x", number_slider_4), End=expr("-x", number_slider_4))
crv = Curve(simplify([item_4.Item1, item_4.Item]))
pline_3 = PolyLine(Vertices=pt_2, Closed=False)
pline_4 = PolyLine(Vertices=pt, Closed=False)
cull = CullPattern(List=extn, CullPattern=panel)
crv_2 = Curve(cull)
cull_2 = CullPattern(List=extn_2, CullPattern=panel)
crv_3 = Curve(cull_2)
explode_3 = Explode(Curve=crv_3, Recursive=True)  # -> Segments, Vertices
explode_4 = Explode(Curve=crv_2, Recursive=True)  # -> Segments, Vertices
explode_5 = Explode(Curve=pline_4, Recursive=True)  # -> Segments, Vertices
explode_6 = Explode(Curve=pline_3, Recursive=True)  # -> Segments, Vertices
end = EndPoints(Curve=[explode_3.Segments, explode_4.Segments, explode_6.Segments, explode_5.Segments])  # -> Start, End
ln_3 = Line(StartPoint=end.Start, EndPoint=end.End)
dupln = RemoveDuplicateLines(Lines=flatten(ln_3), Tolerance=0.01)
context_bake = ContextBake(CrvType2=crv)
context_bake_2 = ContextBake(CrvType1=dupln)
context_print = ContextPrint(Text="20220929_V9")
